# Dynamo graph DesignScriptByTuan.dyn (Dynamo 2.17.0.3472)

# group: Design Script by Tuan
boolean = BoolSelector(false)
python_script = Python(IN[0]=boolean)  # CPython3
# ---------- python_script.python (2 lines) ----------
f = open(r"C:\Users\USER\BIM\Training-Dynamo-2024\DesignScriptByTuan.py", "r")
OUT = f.read()
# ----------------------------------------
python_script_from_string = PythonStringNode(script=python_script)  # CPython3; unwired: IN[0]
