# Dynamo graph Lession04_Tuan.dyn (Dynamo 2.17.0.3472)

code_block = CodeBlock { -5..20; }
code_block_2 = CodeBlock { -5..100..5; }
code_block_3 = CodeBlock { -10..60..3; }
code_block_4 = CodeBlock(x=code_block, y=code_block_2, z=code_block_3) { Point.ByCoordinates(x,y,z); }
python_script = Python(IN[0]=code_block_4)  # CPython3; unwired: IN[1]
# ---------- python_script.python (16 lines) ----------
# Load the Python Standard and DesignScript Libraries
import sys
import clr
clr.AddReference('ProtoGeometry')
from Autodesk.DesignScript.Geometry import *


def getPointsByEvenX(element):
    points = [point for point in element if point.X %2 == 0 and point.X > 0]
    return points
    
# Input points
input = IN[0]

# Output points
OUT = getPointsByEvenX(input)
# ----------------------------------------
python_script_2 = Python(IN[0]=code_block_4)  # CPython3
# ---------- python_script_2.python (16 lines) ----------
# Load the Python Standard and DesignScript Libraries
import sys
import clr
clr.AddReference('ProtoGeometry')
from Autodesk.DesignScript.Geometry import *


def getPointsByOddY(element):
    points = [point for point in element if point.Y %2 == 1 and point.Y > 0]
    return points
    
# Input points
input = IN[0]

# Output points
OUT = getPointsByOddY(input)
# ----------------------------------------
python_script_3 = Python(IN[0]=code_block_4)  # CPython3
# ---------- python_script_3.python (16 lines) ----------
# Load the Python Standard and DesignScript Libraries
import sys
import clr
clr.AddReference('ProtoGeometry')
from Autodesk.DesignScript.Geometry import *


def getPointsWithConditions(element):
    points = [point for point in element if point.Z %5 == 0 and point.Y > 0]
    return points
    
# Input points
input = IN[0]

# Output points
OUT = getPointsWithConditions(input)
# ----------------------------------------
